# Grasshopper definition AxonFile.gh (Grasshopper 0.9.76)
# plug-ins: Human

# ----
# Axon Widget: To install:
# - Put the .gha and .xml files in the Components Folder:
# -- File > Special Folders > Components Folder.
# -- Or C:\Users\USER\AppData\Roaming\Grasshopper\Libraries
# - Restart Rhino + Grasshopper.
# 
# 
# 
# There are two ways that the widget appears:
# A. By pressing the Alt key and press right click on the canvas.
# B. Pull the wire out of a parameter and press right click on the canvas.
# 
# In case B, the selected component will be automatically connected.
# 
# 
# 
# Each time a new object is instantiated or a component is connected to another, using Axon or native methods, it registers a +1 for the frequency of that component/connection in the database.
# 
# 
# 
# To quit the widget, select a component or click on the canvas outside the widget.
# To access the internal menu, right click in the center circle.
# 
# 
# 
# There are 4 modes:
# 1. By Category.
# This mode consists of two levels. The first presents the tabs, when you select one, appears the second level with the components separated by groups. You can pass the second level to the first pressing left click on the center circle.
# 
# 2. By Frequency.
# If you call the widget pressing Alt (way A), will appear the most frequently used components in the database. When you call it from a wire (way B), will appear the components that have been connected (in that component) more times.
# 
# 3. By Parameter.
# Works as By Frequency but for way B will appear the components that have been connected more times in the parameter type of wire.
# 
# 4. By Random.
# Randomly choose the components.
# 
# 
# 
# You can adjust some attributes from the widget menu > Attributes. The size of the icons, the radius of the center circle and the maximum number of components that appear. Do not make adjustments when the widget is visible and the mode is by frequency.
# 
# 
# 
# To enable/disable it: Display > Canvas Widgets > Axon.
# 
# 
# 
# 
# 
# Report bugs to dga_3@hotmail.com
# Source code: https://github.com/DanielAbalde/AxonWidget
# Released under GNU GENERAL PUBLIC LICENSE
# 
# 07/03/2015
# 
# - Daniel Abalde
# Load assembly: > Right click on WriteFromFile, TopComponents, ResetRoot (VB script components).
# > Manage assemblies...
# > add
# 
# Generally in:
# C:\Users\USER\AppData\Roaming\Grasshopper\Libraries\AxonWidget.gha
# 
# > OK
# Write connections from gh files in the Axon Database
# Steps: 1. Load the assembly.
# 2. Change the folder path.
# 3. Adjusts the input files.
# 4. Set Write to True.
# 
# You have to close the pop-up windows that may appear.
# The toggle will get in False when finished.
folder_path = Panel("X:\Grasshopper")
subfolders = BooleanToggle(True)
panel = Panel("""*gh
*ghx""")
dir = DirectoryContents(FolderPath=folder_path, Filter=panel, IncludeSubfolders=subfolders)  # -> flatten(FilePaths), FileNames
series = Series(Start=0, Step=1, Count=Slider(5, range=1..1110))
write = BooleanToggle(False)
item = ListItem(List=dir.FilePaths, Index=series, Wrap=True)
writefromfile = VBScript(Write=write, Files=item, Reference="C:\Users\Dani\AppData\Roaming\Grasshopper\Libraries\AxonWidget.gha")  # -> out; inputs Files: list
# ---------- writefromfile: VB ----------
    If Not write Then Exit Sub

    If files Is Nothing Or Files.count = 0 Then Exit Sub

    Dim axon As axon = GetAxonWidget
    If Axon Is Nothing Then Exit Sub

    Rhinoapp.WriteLine(vbCrlf & "Axon.XML.WriteFromFile...")
    For i As int32 = 0 To Files.count - 1
      rhinoapp.WriteLine(String.Format("Writing: {0}/{1} | File: {2}", i + 1, Files.count, Files(i)))
      Axon.AxonXML.WriteFromFile(Files(i))
    Next

    Axon.AxonXML.XSortComponentsByFrecuency(True)

    If Me.Component.Params.Input(0).sourceCount = 0 Then Exit Sub
    Dim Toggle As grasshopper.Kernel.Special.GH_BooleanToggle =
      DirectCast(Me.Component.Params.Input(0).Sources.last(), kernel.Special.GH_BooleanToggle)
    If Toggle Is Nothing Then Exit Sub
    Toggle.Value = False
    toggle.ExpireSolution(True)
# ---------- writefromfile: VB additional code ----------
  Function GetAxonWidget() As Axon
    For Each w As gui.Widgets.GH_Widget In instances.ActiveCanvas.Widgets
      If w.Name.Equals("Axon") Then
        Return DirectCast(w, Axon)
        Exit For
      End If
    Next
    Return Nothing
  End Function
# ---------- end writefromfile ----------

# ----
# Reset Axon Database
# Empty the xml and add a new root.
reset = Button()
resetroot = VBScript(Reset=reset, Reference="C:\Users\Dani\AppData\Roaming\Grasshopper\Libraries\AxonWidget.gha")  # -> out
# ---------- resetroot: VB ----------
    If Not reset Then Exit Sub

    Dim axon As axon = GetAxonWidget()
    If Axon Is Nothing Then Exit Sub

    Axon.AxonXML.ResetRoot()
# ---------- resetroot: VB additional code ----------
  Function GetAxonWidget() As Axon
    For Each w As gui.Widgets.GH_Widget In instances.ActiveCanvas.Widgets
      If w.Name.Equals("Axon") Then
        Return DirectCast(w, Axon)
        Exit For
      End If
    Next
    Return Nothing
  End Function
# ---------- end resetroot ----------

# ----
# Deserialize the top components of the Axon Database
number_slider = Slider(5, range=0..100)
topcomponents = VBScript(
    MaxC=number_slider,
    MaxP=Slider(5, range=0..100),
    Reference="C:\Users\Dani\AppData\Roaming\Grasshopper\Libraries\AxonWidget.gha")  # -> out, Names, Frequency, IsInput, IndexParam, Connected, ConnIdxParam, ConnFrequency; disabled
# ---------- topcomponents: VB ----------
    Component.Params.Input(0).Name = "Maximum components"
    Component.Params.Input(0).Description = "Maximum number of components to deserialize"
    Component.Params.Input(1).Name = "Maximum parameters"
    Component.Params.Input(1).Description = "Maximum number of connections per parameter to deserialize"
      
    Dim Axon As Axon = GetAxonWidget()
    If Axon Is Nothing Then Exit Sub
    If Not Axon.Visible Or Not axon.AxonXML.Loaded Then Exit Sub

    Axon.AxonXML.XSortComponentsByFrecuency(True)

    Dim Leak As List(Of Tuple(Of IGH_ObjectProxy, Integer, Boolean(), Integer(), IGH_ObjectProxy(), Integer(), Integer())) =
      Axon.AxonXML.GetTopComponentsLeak(MaxC, MaxP)

    Dim _Names As New datatree(Of String)
    Dim _Frequency As New datatree(Of Integer)
    Dim _IsInput As New datatree(Of Boolean)
    Dim _IndexParam As New datatree(Of Integer)
    Dim _Connected As New datatree(Of String)
    Dim _ConnectedIndexParam As New datatree(Of Integer)
    Dim _ConnectedFrequency As New datatree(Of Integer)

    For i As int32 = 0 To Leak.Count - 1
      Dim t As Tuple(Of IGH_ObjectProxy, Integer, Boolean(), Integer(), IGH_ObjectProxy(), Integer(), Integer()) = Leak(i)
      Dim p0 As New gh_path(i)
      _names.add(t.item1.Desc.name, p0)
      _Frequency.add(t.item2, p0)

      For j As int32 = 0 To t.item5.count - 1
        If t.item5(j) Is Nothing Then Continue For
        _IsInput.add(t.item3(j), p0)
        _IndexParam.add(t.item4(j), p0)
        _Connected.add(t.item5(j).Desc.Name, p0)
        _ConnectedIndexParam.add(t.item6(j), p0)
        _ConnectedFrequency.add(t.item7(j), p0)
        ' print(String.Format("Component: {0}, Frequency: {1}, {2}: {3}, {4}: {5}, {6}: {7}, Frequency: {8}",
        '    _names.branch(i)(0), _Frequency.branch(i)(0), If(_IsInput.branch(i)(j), "input", "output"),
        '    _indexParam.branch(i)(j), If(_isInput.branch(i)(j), "source", "target"), _Connected.branch(i)(j),
        '   If(_IsInput.branch(i)(j), "output", "input"), _ConnectedIndexParam.branch(i)(j), _connectedFrequency.branch(i)(j)))
      Next
      ' print(vbCrlf)
    Next

    names = _Names
    Frequency = _Frequency
    IsInput = _IsInput
    IndexParam = _IndexParam
    Connected = _Connected
    ConnIdxParam = _ConnectedIndexParam
    ConnFrequency = _ConnectedFrequency
# ---------- topcomponents: VB additional code ----------
  Function GetAxonWidget() As Axon
    For Each w As gui.Widgets.GH_Widget In instances.ActiveCanvas.Widgets
      If w.Name.Equals("Axon") Then
        Return DirectCast(w, Axon)
        Exit For
      End If
    Next
    Return Nothing
  End Function
# ---------- end topcomponents ----------
bool = Boolean(topcomponents.IsInput)

# ---- group: Connected components
dispatch = Dispatch(List=topcomponents.Connected, DispatchPattern=bool)  # -> ListA, ListB

# ---- group: Index parameters
dispatch_2 = Dispatch(List=topcomponents.ConnIdxParam, DispatchPattern=bool)  # -> ListA, ListB

# ---- group: Frequency
dispatch_3 = Dispatch(List=topcomponents.ConnFrequency, DispatchPattern=bool)  # -> ListA, ListB

# ---- group: Index parameters
dispatch_4 = Dispatch(List=topcomponents.IndexParam, DispatchPattern=bool)  # -> ListA, ListB

# ----
frequency = Integer(topcomponents.Frequency)

# ---- group: Components
names = Text(topcomponents.Names)

# ----
expression = Expression(x=flatten(names), y=flatten(frequency), Expression="Format(\"Component: {0}, Frequency: {1}\", x, y)")
panel_2 = Panel(expression)
